# Dynamo graph Host-shaft to soild.dyn (Dynamo 3.3.0.6316)
# packages: Synthesize toolkit 25.6.501, DynaMEP 1.2.8, BattleBIM 2018.12.17, Bakery 2016.4.7, Chynamo 0.8.5, Zhukoven.com 2021.2.27, archi-lab.net 2025.300.1225, Genius Loci 2024.5.29, designtech 1.0.8

# note: Dynamo Script Version:
# This script has been created using:
# -Dynamo Revit Version 2.19.4
# -Revit 2014.3

# group: Script Outlines
# note: Script Prerequisites And Definition:
# this script is mainly for converting the shaft opening Revit category to a solid element. through  "Direct shape dynamo object " can be seen visually and is selectable inside the Revit model for many reasons, and not limited to:
# 1- visual checks
# 2-coordination with the architecture shafts
# Needed project parameters:
# Before start using this script you have to create some project parameters assigned to
# "Generic Model Category"
# The objectibes of these parameters intented to collect all needed inforamtion about the origneal shaft opening and new soild geometry "Direct shape" to be used later for anlaysis and comparing puroposes
# the generic Model Category will represent the shaft opening as a solid geomerty and conating all information needed mapped from the origenal shaft opening revit category.
# These parameters as follows and not limited to:
# 1-Shaft Opening Base Level  .... text param.
# 2-Shaft Opening Base offset .... length param.
# 3-Shaft Opening Top Level   .... text param.
# 4-Shaft Opening Top offset  .... length param.
# 5-Shaft Opening - PX-Coordiates .... integer param.
# 6-Shaft Opening - PY-Coordiates .... integer param.
# 7-Shaft Opening - PZ-Coordiates .... integer param.
# 8-Shaft Opening Height .... length param.
# 9-Shaft Opening Area .... Area param.

# group: select all shaft opening category from Revit mdeol
n01_select_all_shafts = DSModelElementsByCategorySelection("OST_ShaftOpening")  # "01-Select All shafts"; 1 picked in the model; graph input

boundingBoxXYZ = RevitModel.Element.BoundingBoxXYZ(elements=n01_select_all_shafts)

# group: get bouding box for all shaft opening
boundingBox = Element.BoundingBox(element=n01_select_all_shafts)

# group: collect the cooridante system for the bouding boxes
contextCoordinateSystem = BoundingBox.ContextCoordinateSystem(boundingBox=boundingBox)
ZAxis = CoordinateSystem.ZAxis(coordinateSystem=contextCoordinateSystem)
origin = CoordinateSystem.Origin(coordinateSystem=contextCoordinateSystem)

# group: Get Shaft Boundaries
original = Custom[SP.Collector.ElementSketch.Original](VARelement=n01_select_all_shafts)  # package Synthesize toolkit; Get the actual sketch lines of a sketch based element (floor, ceiling, modified wall, etc.) . You can optionally fetch the matching model curves, however this might prove comptationally heavy on larger data sets. Does not work with elements from linked files.
byJoinedCurves = PolyCurve.ByJoinedCurves(curves=original.VARcurves)

# group: collect inforamtion about the boudning boxes
minPoint = BoundingBox.MinPoint(boundingBox=boundingBox)
maxPoint = BoundingBox.MaxPoint(boundingBox=boundingBox)

point = dtGeometry.Deconstruct.Point(point=minPoint)
point_2 = dtGeometry.Deconstruct.Point(point=maxPoint)

# group (continued): collect inforamtion about the boudning boxes
byCoordinates = Point.ByCoordinates(x=point.x, y=point.y, z=point_2.z)
byStartPointEndPoint = Line.ByStartPointEndPoint(startPoint=minPoint, endPoint=byCoordinates)
length = Curve.Length(curve=byStartPointEndPoint)

# group: convert shaft opening boudaries to solid element by sweep
sweepAsSolid = Curve.SweepAsSolid(curve=byJoinedCurves, path=byStartPointEndPoint)

# group: create direct shape 3D solid element for all shafts
categories = Categories("OST_GenericModel")
byGeometry = DirectShape.ByGeometry(geometry=sweepAsSolid, category=categories)

# group: add comments
code_block = CodeBlock { "Comments"; }
n02_fill_in_the_comments = StringInput("DirectShape-STR-ShaftOpening")  # "02-Fill in the Comments Parameter"; graph input
setParameterByName = Element.SetParameterByName(element=byGeometry, parameterName=code_block, value=n02_fill_in_the_comments)

# group: override color
color_palette = ColorPalette({R: 0, G: 67, B: 255, A: 255})
overrideColorInView = Element.OverrideColorInView(element=byGeometry, color=color_palette)

# group: get shaft opening Base level data
code_block_2 = CodeBlock { "Base Constraint"; "Base Offset"; }
getParameterValueByName = Element.GetParameterValueByName(element=n01_select_all_shafts, parameterName=code_block_2.out0)
name = Level.Name(level=getParameterValueByName)
getParameterValueByName_2 = Element.GetParameterValueByName(element=n01_select_all_shafts, parameterName=code_block_2.out1)
string_from_object = FromObject(object=getParameterValueByName)

# group: add base level data
code_block_3 = CodeBlock { "Shaft Opening Base Level"; "Shaft Opening Base offset"; }
setParameterByName_2 = Element.SetParameterByName(element=byGeometry, parameterName=code_block_3.out0, value=name)
setParameterByName_3 = Element.SetParameterByName(element=byGeometry, parameterName=code_block_3.out1, value=getParameterValueByName_2)

# group: get shaft opening Toplevel data
code_block_4 = CodeBlock { "Top Constraint"; "Top Offset"; }
getParameterValueByName_3 = Element.GetParameterValueByName(element=n01_select_all_shafts, parameterName=code_block_4.out0)
name_2 = Level.Name(level=getParameterValueByName_3)
string_from_object_2 = FromObject(object=getParameterValueByName_3)
getParameterValueByName_4 = Element.GetParameterValueByName(element=n01_select_all_shafts, parameterName=code_block_4.out1)

# group: filtering NULL level values
isNull = Object.IsNull(object=name_2)
code_block_5 = CodeBlock { true; }
allIndicesOf = List.AllIndicesOf(list=isNull, item=code_block_5)
getItemAtIndex = List.GetItemAtIndex(list=string_from_object_2, index=allIndicesOf)
uniqueItems = List.UniqueItems(list=getItemAtIndex)
replaceItemAtIndex = Custom[CW.List.ReplaceItemAtIndex+](VARseq=name_2, VARindex=allIndicesOf, VARreplacement=uniqueItems)  # package Synthesize toolkit; Replaces the item at a given index (or list of indices) of a list by another item

# group: add top level data
code_block_6 = CodeBlock { "Shaft Opening Top Level"; "Shaft Opening Top offset"; }
setParameterByName_4 = Element.SetParameterByName(element=byGeometry, parameterName=code_block_6.out0, value=replaceItemAtIndex)
setParameterByName_5 = Element.SetParameterByName(element=byGeometry, parameterName=code_block_6.out1, value=getParameterValueByName_4)

type = Object.Type(object=byGeometry)

# group: create model group for all shaft opening
flatten = List.Flatten(list=byGeometry)
byElements = Group.ByElements(elements=flatten)

# group: get group type
code_block_7 = CodeBlock { "Type"; }
getParameterValueByName_5 = Element.GetParameterValueByName(element=byElements, parameterName=code_block_7)
groupType = Group.GroupType(group=byElements)

# group: set group name
code_block_8 = CodeBlock { "Family and Type"; }
getParameterValueByName_6 = Element.GetParameterValueByName(element=byElements, parameterName=code_block_8)
n03_group_name = StringInput("STR-Shaft Opening")  # "03-Group Name"; graph input
setName = Custom[Element.SetName](element=getParameterValueByName_6, name=n03_group_name)  # package BattleBIM

point_3 = dtGeometry.Deconstruct.Point(point=origin)

# group (continued): collect the cooridante system for the bouding boxes
type_2 = Object.Type(object=point_3.x)

# group: add data about shaft location point x point y point z coordinates
code_block_9 = CodeBlock { "Shaft Opening - PX-Coordiates"; "Shaft Opening - PY-Coordiates"; "Shaft Opening - PZ-Coordiates"; }
setParameterByName_6 = Element.SetParameterByName(element=byGeometry, parameterName=code_block_9.out0, value=point_3.x)
setParameterByName_7 = Element.SetParameterByName(element=byGeometry, parameterName=code_block_9.out1, value=point_3.y)
setParameterByName_8 = Element.SetParameterByName(element=byGeometry, parameterName=code_block_9.out2, value=point_3.z)

# group: set shaft opening height
code_block_10 = CodeBlock { "Shaft Opening Height"; }
setParameterByName_9 = Element.SetParameterByName(element=byGeometry, parameterName=code_block_10, value=length)

# group: collecting shaft shape Area
byPatch = Surface.ByPatch(closedCurve=byJoinedCurves)
area = Surface.Area(surface=byPatch)
convert_by_units = DynamoUnitConvert(area, MeasurementType="autodesk.unit.quantity:area-1.0.2", FromConversion="autodesk.unit.unit:squareMillimeters-1.0.1", ToConversion="autodesk.unit.unit:squareMeters-1.0.1")

# group: set shaft opening Area
code_block_11 = CodeBlock { "Sahft Opening Area"; }
setParameterByName_10 = Element.SetParameterByName(element=byGeometry, parameterName=code_block_11, value=convert_by_units)

flatten_2 = List.Flatten(list=byGeometry)
created_shafts_number = List.Count(list=flatten_2)
created_shafts = Watch(created_shafts_number)  # graph output

# group: Creating a schedule > Create a schedule view for the created 3D Shsft opening
n04_schedule_name = StringInput("STR-Shaft Opening Schedule")  # "04-Schedule Name"; graph input
schedule_type = ScheduleTypes("RegularSchedule")
createSchedule = ScheduleView.CreateSchedule(category=categories, name=n04_schedule_name, scheduleType=schedule_type)

# group: Creating a schedule > add some fields to the schedule
schedulableFields = ScheduleView.SchedulableFields(scheduleView=createSchedule)
string_from_object_3 = FromObject(object=schedulableFields)
code_block_12 = CodeBlock { "Shaft"; }
contains = String.Contains(string=string_from_object_3, searchFor=code_block_12)
code_block_13 = CodeBlock { true; }
allIndicesOf_2 = List.AllIndicesOf(list=contains, item=code_block_13)
code_block_14 = CodeBlock { "Comments"; }
firstIndexOf = List.FirstIndexOf(list=string_from_object_3, item=code_block_14)
list_create = List.Create(item0=allIndicesOf_2, item1=firstIndexOf)
getItemAtIndex_2 = List.GetItemAtIndex(list=schedulableFields, index=list_create)
addFields = ScheduleView.AddFields(scheduleView=createSchedule, fields=getItemAtIndex_2)

# group: Brain storming
getParameterValueByName_7 = Element.GetParameterValueByName(element=n01_select_all_shafts, parameterName=code_block_4.out0)
code_block_15 = CodeBlock { "Unconnected"; }
allIndicesOf_3 = List.AllIndicesOf(list=getParameterValueByName_7, item=code_block_15)
getItemAtIndex_3 = List.GetItemAtIndex(list=getParameterValueByName_7, index=allIndicesOf_3)
type_3 = Object.Type(object=getParameterValueByName_3)
code_block_16 = CodeBlock { 1; }
getItemAtIndex_4 = List.GetItemAtIndex(list=type_3, index=code_block_16)
code_block_17 = CodeBlock { "Revit.Elements.Level"; }
removeIfNot = List.RemoveIfNot(list=getParameterValueByName_7, type=code_block_17)
name_3 = Level.Name(level=removeIfNot)
filter = List.Filter(list=getParameterValueByName_3)  # unwired: condition
code_block_18 = CodeBlock { "Revit.Elements.Level"; }
removeIfNot_2 = List.RemoveIfNot(type=code_block_18)  # unwired: list
python_null_2_string = Custom[Python Null 2 String](VARIN=name_2, VARString=code_block_15)  # package Synthesize toolkit; Python Null 2 String
get_indices_of_null_values = Custom[Get Indices of Null Values](list=name_2)  # package Bakery; .
nullIndice = Custom[NullIndice]()  # package Chynamo; unwired: list
containsNull = Custom[List.ContainsNull]()  # package Zhukoven.com; unwired: list
replaceNull = Custom[CW.List.ReplaceNull]()  # package Synthesize toolkit; Replaces all null values within a given list with a substitute; unwired: VARseq, VARreplacement
indexOf = List.IndexOf(list=getParameterValueByName_7)  # unwired: element
categories_2 = Categories("OST_Levels")
contains_2 = List.Contains(list=getParameterValueByName_7, item=code_block_15)
code_block_19 = CodeBlock { true; }
contains_3 = List.Contains(list=contains_2, item=code_block_19)

clear_list = Custom[Clear List](input=name_2)  # package archi-lab.net; This node will remove all Null and Empty Lists from any list.
slected_shafts_number = List.Count(list=n01_select_all_shafts)
levelsCollector = dtRevit.Collector.LevelsCollector()

# group: brain storming
code_block_20 = CodeBlock { 0; }
getItemAtIndex_5 = List.GetItemAtIndex(list=original.VARcurves, index=code_block_20)
line_patterns = LinePatterns("Dash")
line_styles = LineStyleUi("<Thin Lines>")
setCurve = DetailCurve.SetCurve()  # unwired: detailCurve, curve
view_type = ViewTypesUi("EngineeringPlan")
getByType = archilab.Revit.Views.Views.GetByType(viewType=view_type)
byCurve = DetailCurve.ByCurve(view=getByType, curve=original.VARcurves)
level_plane = Custom[Level Plane](level=levelsCollector)  # package Genius Loci; Constructs a Plane from a level.
intersect = Geometry.Intersect(geometry=level_plane, other=sweepAsSolid, lacing=CrossProduct)
perimeterCurves = Surface.PerimeterCurves(surface=intersect)
getIsoline = Surface.GetIsoline(surface=intersect)
code_block_21 = CodeBlock { 1; }
getIsoline_2 = Surface.GetIsoline(surface=intersect, parameter=code_block_21)

if_ = dtCore.Logic.If(test=contains_3)  # unwired: ifTrue, ifFalse
create = dtGeometryPrimitives.Line.Create()  # unwired: startPoint, endPoint
