# Dynamo graph LinkedModel-shaft to soild.dyn (Dynamo 3.3.0.6316)
# packages: DynaMEP 1.2.8, Synthesize toolkit 25.6.501, designtech 1.0.8, BattleBIM 2018.12.17, IPOGNodes 1.0.3, Orchid 3.2.1.6430, archi-lab.net 2025.300.1225

# group: Script Outlines
# this is for Linked Models
# note: Script Prerequisites And Definition:
# this script is mainly for converting the shaft opening Revit category to a solid element. through  "Direct shape dynamo object " can be seen visually and is selectable inside the Revit model for many reasons, and not limited to:
# 1- visual checks
# 2-coordination with the architecture shafts
# Needed project parameters:
# Before start using this script you have to create some project parameters assigned to
# "Generic Model Category"
# The objectibes of these parameters intented to collect all needed inforamtion about the origneal shaft opening and new soild geometry "Direct shape" to be used later for anlaysis and comparing puroposes
# the generic Model Category will represent the shaft opening as a solid geomerty and conating all information needed mapped from the origenal shaft opening revit category.
# These parameters as follows and not limited to:
# 1-Shaft Opening Base Level  .... text param.
# 2-Shaft Opening Base offset .... length param.
# 3-Shaft Opening Top Level   .... text param.
# 4-Shaft Opening Top offset  .... length param.
# 5-Shaft Opening - PX-Coordiates .... integer param.
# 6-Shaft Opening - PY-Coordiates .... integer param.
# 7-Shaft Opening - PZ-Coordiates .... integer param.
# 8-Shaft Opening Height .... length param.
# 9-Shaft Opening Area .... Area param.

boolean = BoolSelector(true)

# group: collect Linked Revit Model instances
getLinkInstance = RevitModel.LinkedElement.GetLinkInstance(fresh=boolean)
categories = Categories("OST_ShaftOpening")

# group: filter all linked Revit models to get specific model example : Arch model
n01_revit_model_abbreviation_code = StringInput("arch")  # "01-Revit Model Abbreviation Code"; graph input
contains = String.Contains(string=getLinkInstance.LinkedName, searchFor=n01_revit_model_abbreviation_code)
code_block = CodeBlock { true; }
indexOf = List.IndexOf(list=contains, element=code_block)
getItemAtIndex = List.GetItemAtIndex(list=getLinkInstance.Revitlinkinstance, index=indexOf)
filterByBoolMask = List.FilterByBoolMask(list=getLinkInstance.LinkedName, mask=contains)

# group (continued): collect Linked Revit Model instances
ofCategory = Custom[LinkElement.OfCategory](getItemAtIndex, category=categories)  # package IPOGNodes; Gets all Elements from a RevitLinkInstance of a specified category

# group: get bouding box for all shaft opening
boundingBoxXYZ = RevitModel.Element.BoundingBoxXYZ(elements=ofCategory)
boundingBox = Element.BoundingBox(element=ofCategory)

# group: collect the cooridante system for the bouding boxes
contextCoordinateSystem = BoundingBox.ContextCoordinateSystem(boundingBox=boundingBox)
ZAxis = CoordinateSystem.ZAxis(coordinateSystem=contextCoordinateSystem)
origin = CoordinateSystem.Origin(coordinateSystem=contextCoordinateSystem)
point = dtGeometry.Deconstruct.Point(point=origin)
type = Object.Type(object=point.x)

# group: temperory copy shafts from the linked model to get curves and then delete them
copyElement = Orchid.RevitProject.Common.Link.CopyElement(instance=getItemAtIndex, element=ofCategory)

# group: Get Shaft Boundaries
original = Custom[SP.Collector.ElementSketch.Original](VARelement=copyElement)  # package Synthesize toolkit; Get the actual sketch lines of a sketch based element (floor, ceiling, modified wall, etc.) . You can optionally fetch the matching model curves, however this might prove comptationally heavy on larger data sets. Does not work with elements from linked files.
byJoinedCurves = PolyCurve.ByJoinedCurves(curves=original.VARcurves)

# group: collect inforamtion about the boudning boxes
minPoint = BoundingBox.MinPoint(boundingBox=boundingBox)
point_2 = dtGeometry.Deconstruct.Point(point=minPoint)
maxPoint = BoundingBox.MaxPoint(boundingBox=boundingBox)
point_3 = dtGeometry.Deconstruct.Point(point=maxPoint)
byCoordinates = Point.ByCoordinates(x=point_2.x, y=point_2.y, z=point_3.z)
byStartPointEndPoint = Line.ByStartPointEndPoint(startPoint=minPoint, endPoint=byCoordinates)
length = Curve.Length(curve=byStartPointEndPoint)

# group: convert shaft opening boudaries to solid element by sweep
sweepAsSolid = Curve.SweepAsSolid(curve=byJoinedCurves, path=byStartPointEndPoint)

# group: create direct shape 3D solid element for all shafts
categories_2 = Categories("OST_GenericModel")
byGeometry = DirectShape.ByGeometry(geometry=sweepAsSolid, category=categories_2)
type_2 = Object.Type(object=byGeometry)

# group: add comments
code_block_2 = CodeBlock { "Comments"; }
n02_fill_in_comments_parameter = StringInput("DirectShape-AR-ShaftOpening")  # "02-Fill in comments Parameter"; graph input
setParameterByName = Element.SetParameterByName(element=byGeometry, parameterName=code_block_2, value=n02_fill_in_comments_parameter)

# group: get shaft opening Base level data
code_block_3 = CodeBlock { "Base Constraint"; "Base Offset"; }
getParameterValueByName = Element.GetParameterValueByName(element=ofCategory, parameterName=code_block_3.out0)
name = Level.Name(level=getParameterValueByName)
getParameterValueByName_2 = Element.GetParameterValueByName(element=ofCategory, parameterName=code_block_3.out1)
string_from_object = FromObject(object=getParameterValueByName)

# group: add base level data
code_block_4 = CodeBlock { "Shaft Opening Base Level"; "Shaft Opening Base offset"; }
setParameterByName_2 = Element.SetParameterByName(element=byGeometry, parameterName=code_block_4.out0, value=name)
setParameterByName_3 = Element.SetParameterByName(element=byGeometry, parameterName=code_block_4.out1, value=getParameterValueByName_2)

# group: get shaft opening Toplevel data
code_block_5 = CodeBlock { "Top Constraint"; "Top Offset"; }
getParameterValueByName_3 = Element.GetParameterValueByName(element=ofCategory, parameterName=code_block_5.out0)
string_from_object_2 = FromObject(object=getParameterValueByName_3)
name_2 = Level.Name(level=getParameterValueByName_3)
getParameterValueByName_4 = Element.GetParameterValueByName(element=ofCategory, parameterName=code_block_5.out1)

# group: add top level data
code_block_6 = CodeBlock { "Shaft Opening Top Level"; "Shaft Opening Top offset"; }
setParameterByName_4 = Element.SetParameterByName(element=byGeometry, parameterName=code_block_6.out0, value=name_2)
setParameterByName_5 = Element.SetParameterByName(element=byGeometry, parameterName=code_block_6.out1, value=getParameterValueByName_4)

# group: create model group for all shaft opening
flatten = List.Flatten(list=byGeometry)
byElements = Group.ByElements(elements=flatten)

# group: get group type
code_block_7 = CodeBlock { "Type"; }
getParameterValueByName_5 = Element.GetParameterValueByName(element=byElements, parameterName=code_block_7)
groupType = Group.GroupType(group=byElements)

# group: set group name
code_block_8 = CodeBlock { "Family and Type"; }
getParameterValueByName_6 = Element.GetParameterValueByName(element=byElements, parameterName=code_block_8)
n05_generic_model_group_name = StringInput("ARCH-Shaft Opening")  # "05-Generic Model Group Name"; graph input
setName = Custom[Element.SetName](element=getParameterValueByName_6, name=n05_generic_model_group_name)  # package BattleBIM; Gets the name of a given Revit element **Forks

# group: add data about shaft location point x point y point z coordinates
code_block_9 = CodeBlock { "Shaft Opening - PX-Coordiates"; "Shaft Opening - PY-Coordiates"; "Shaft Opening - PZ-Coordiates"; }
setParameterByName_6 = Element.SetParameterByName(element=byGeometry, parameterName=code_block_9.out0, value=point.x)
setParameterByName_7 = Element.SetParameterByName(element=byGeometry, parameterName=code_block_9.out1, value=point.y)
setParameterByName_8 = Element.SetParameterByName(element=byGeometry, parameterName=code_block_9.out2, value=point.z)

# group: set shaft opening height
code_block_10 = CodeBlock { "Shaft Opening Height"; }
setParameterByName_9 = Element.SetParameterByName(element=byGeometry, parameterName=code_block_10, value=length)

# group: collecting shaft shape data
byPatch = Surface.ByPatch(closedCurve=byJoinedCurves)
area = Surface.Area(surface=byPatch)
convert_by_units = DynamoUnitConvert(area, MeasurementType="autodesk.unit.quantity:area-1.0.2", FromConversion="autodesk.unit.unit:squareMillimeters-1.0.1", ToConversion="autodesk.unit.unit:squareMeters-1.0.1")

# group: set shaft opening Area
code_block_11 = CodeBlock { "Sahft Opening Area"; }
setParameterByName_10 = Element.SetParameterByName(element=byGeometry, parameterName=code_block_11, value=convert_by_units)

# group (continued): temperory copy shafts from the linked model to get curves and then delete them
passThrough = Custom[PassThrough](passThrough=copyElement, waitFor=original.VARcurves)  # package archi-lab.net; Ripped this off from Clockwork. Sorry Andy.
delete = Orchid.RevitProject.Elements.Element.Delete(element=passThrough)
